# Grasshopper definition number04_hops.gh (Grasshopper 1.0.7)
# plug-ins: Bifocals
# Spherical spikey thing

randomizer02 = GetNumber(Slider(5, range=0..10), AtLeast=1, AtMost=1, Maximum=1.797693135e+308, Minimum=-1.797693135e+308, TreeAccess=False)
scale = GetNumber(Slider(4, range=1..10), AtLeast=1, AtMost=1, Maximum=1.797693135e+308, Minimum=-1.797693135e+308, TreeAccess=False)
randomizer01 = GetNumber(Slider(5, range=0..10), AtLeast=1, AtMost=1, Maximum=1.797693135e+308, Minimum=-1.797693135e+308, TreeAccess=False)
voxsize = GetNumber(Slider(4, range=1..6), AtLeast=1, AtMost=1, Maximum=1.797693135e+308, Minimum=-1.797693135e+308, TreeAccess=False)
rectangle = Rectangle(Plane=PlaneXY(0, 0, 0), XSize=voxsize, YSize=voxsize, Radius=0)  # -> Rectangle, Length
boxrec = BoxRectangle(Rectangle=rectangle.Rectangle, Height=voxsize)
volume = Volume(Geometry=boxrec)  # -> Volume, Centroid
division = Division(A=scale, B="10")
number_slider = Slider(10, range=0..15)
scale_2 = Scale(Geometry=boxrec, Center=volume.Centroid, Factor=division)  # -> Geometry, Transform
arrbox = BoxArray(Geometry=scale_2.Geometry, Cell=boxrec, XCount=number_slider, YCount=number_slider, ZCount=number_slider)  # -> Geometry, Transform
area = Area(Geometry=arrbox.Geometry)  # -> Area, Centroid
bbox = BoundingBox(Content=arrbox.Geometry, Plane=PlaneXY(0, 0, 0), UnionBox=True)  # -> Box, Box_2
popgeo = PopulateGeometry(Geometry=bbox.Box, Count=randomizer01, Seed=randomizer02)
volume_2 = Volume(Geometry=arrbox.Geometry)  # -> Volume, Centroid
cp = ClosestPoint(Point=volume_2.Centroid, Cloud=popgeo)  # -> ClosestPoint, CPIndex, Distance
larger = LargerThan(FirstNumber=cp.Distance, SecondNumber=Slider(15, range=0..100))  # -> LargerThan, OrEqualTo
cull = CullPattern(List=arrbox.Geometry, CullPattern=larger.LargerThan)
brep = Brep(cull)
smesh = SimpleMesh(Brep=brep)
mesh = Mesh(smesh)
item = ListItem(List=mesh, Index=0, Wrap=True)
subd = SubD(mesh)
context_bake = ContextBake(Geometry=mesh)
